# Grasshopper definition w16_Nishtha's inputs.gh (Grasshopper 0.9.76)
# plug-ins: Firefly.X, Firefly.Core

ports_available = COMPortsAvailable()
open_port = OpenClosePort(OpenClosePort=Toggle(True), PortNumber="10", BaudRate=9600)
toggle = BooleanToggle(True)
timer = Timer(TimerInterval=20, Target=uno_read)
panel = Panel(open_port)
toggle_2 = BooleanToggle(True)
uno_read = UnoRead(StartReadingValues=toggle_2, PortNumber="10")  # -> AnalogPin0, AnalogPin1, AnalogPin2, AnalogPin3, AnalogPin4, AnalogPin5, DigitalPin2, DigitalPin4, DigitalPin7, StatusMessage
uno_write = UnoWrite(
    StartWritingValues=toggle_2,
    DigitalPin13=Toggle(True),
    DigitalPin12=Toggle(True),
    DigitalPin11=0,
    DigitalPin10=0,
    DigitalPin9=0,
    DigitalPin8=0,
    DigitalPin6=0,
    DigitalPin5=0,
    DigitalPin3=0,
    PortNumber="10")  # -> ArduinoOutput, StatusMessage
panel_2 = Panel(uno_read.AnalogPin1)
tracker = ValueTracker(
    uno_read.AnalogPin1,
    TrackerAutoDomain=True,
    TrackerColour=RGB(255, 155, 0),
    TrackerPeriod=10,
    TrackerUpdate=25,
    TrackerDomain=[0, 1])
tracker_2 = ValueTracker(
    uno_read.AnalogPin5,
    TrackerAutoDomain=True,
    TrackerColour=RGB(255, 155, 0),
    TrackerPeriod=10,
    TrackerUpdate=25,
    TrackerDomain=[0, 1])
panel_3 = Panel(uno_read.AnalogPin5)
panel_4 = Panel(uno_write.ArduinoOutput)
panel_5 = Panel(uno_write.StatusMessage)
codegen = CodeGenerator(Input=uno_write.ArduinoOutput)
panel_6 = Panel(codegen)
